# Grasshopper definition GetElements.gh (Grasshopper 1.0.7)
# plug-ins: Rhino.Inside for Autodesk Revit

visible_in_view_filter = VisibleInViewFilter(View=<view referenced from the Revit model>, Inverted=False)
query_elements = QueryElements(Filter=visible_in_view_filter, Limit=100000)  # -> Elements, Count
element_passport = ElementPassport(Element=query_elements.Elements)  # -> DocumentGUID, Document, UniqueID, Id
guid = Guid(query_elements.Elements)
element_version = ElementVersion(Element=query_elements.Elements)  # -> Editable, Created, Version
guid_2 = Panel(element_passport.UniqueID)
element_detals = Panel(query_elements.Elements)
version_guid = Panel(element_version.Version)
text_split = TextSplit(Text=element_detals, Separators=":")  # -> flatten(Result)
text_trim = TextTrim(Text=text_split, Start=True, End=True)
cull_pattern = CullPattern(List=text_trim, CullPattern=[False, False, True])
cull_pattern_2 = CullPattern(List=text_trim, CullPattern=[False, True, False])
cull_pattern_3 = CullPattern(List=text_trim, CullPattern=[True, False, False])  # -> flatten(List)
panel = Panel(cull_pattern_2)
panel_2 = Panel(cull_pattern_3)
panel_3 = Panel(cull_pattern)
concatenate = Concatenate(FragmentA=version_guid, FragmentB=panel_2, JoinSeparator=",")
replace_text = ReplaceText(Text=panel_3, Find="id ", RecursiveReplace=False)
concatenate_2 = Concatenate(FragmentA=concatenate, FragmentB=panel, JoinSeparator=",")
concatenate_3 = Concatenate(FragmentA=concatenate_2, FragmentB=replace_text, JoinSeparator=",")
file_path = FilePath("B:\Git\RevitChangelog\ProtoTypeChangeLog.csv")
read_file = ReadFile(File=file_path, PerLineParse=True)
concatenate_4 = Concatenate(FragmentA=concatenate_3, FragmentB=guid_2, JoinSeparator=",")
replace_text_2 = ReplaceText(Text=read_file, Find=":", Replace=",", RecursiveReplace=False)
replace_text_3 = ReplaceText(Text=concatenate_4, Find=" ", RecursiveReplace=False)  # -> flatten(Result)
replace_text_4 = ReplaceText(Text=replace_text_2, Find=" ", RecursiveReplace=False)  # -> flatten(Result)
panel_4 = Panel(replace_text_3)
panel_5 = Panel(replace_text_4)
ghpython_script = GhPythonScript(x=panel_4, y=panel_5)  # -> simplify(out), a
# ---------- ghpython_script: Python ----------
a = x == y

if x != y:
    b = y
# ---------- end ghpython_script ----------
panel_6 = Panel(ghpython_script.out)
panel_7 = Panel(ghpython_script.a)
dispatch = Dispatch(List=panel_7, DispatchPattern=False)  # -> ListA, ListB
panel_8 = Panel(dispatch.ListA)
panel_9 = Panel(dispatch.ListB)
